# Requirement set ShipRequirements (R2026a)

## 1 [#1] Platform Support
The vessel must provide the shipboard services and resources necessary to support vessel operations.
Rationale: The operator, crew, and owner require the vessel to provide the shipboard services and
resources necessary to conduct vessel operations.

### 1.1 [#2] Electrical Power
The vessel shall provide electrical power necessary to support vessel operations.
Rationale: Electrical power is required to operate propulsion, command and surveillance systems, auxiliary systems, outfitting systems, and mission-specific systems.

#### 1.1.1 [#3] Electrical Power Generation
Generator sets shall be configured to produce the electrical power demanded by the shipboard load schedule for each defined operating condition.
Rationale: Shipboard electrical loads require an onboard source of electrical power when shore-supplied power is unavailable.

#### 1.1.2 [#4] Electrical Power Distribution
The electrical power distribution interfaces shall distribute electrical power from sources to loads as designated in the shipboard load schedule.
Rationale: Generated, stored, or shore-supplied electrical power must be transferred to the systems and equipment that require it.

##### 1.1.2.1 [#46] Stored-Energy Supply
The stored-energy supply interfaces shall supply stored electrical energy to designated loads under defined operating conditions.
Rationale: Stored electrical energy supports designated shipboard loads during defined operating conditions in which immediate power from another source is unavailable or insufficient.

##### 1.1.2.2 [#47] Shore Power
The shore power interfaces shall accept and distribute shore-supplied electrical power for use by designated shipboard loads.
Rationale: Shore-supplied electrical power allows designated vessel services to operate without relying solely on onboard electrical generation while the vessel is connected to shore facilities.

#### 1.1.3 [#5] Electrical Energy Storage
The battery bank shall store electrical energy received from the shipboard electrical distribution system.
Rationale: Electrical energy must be stored so that it is available for later use during defined operating conditions.
(Assumption: Battery Energy Storage System (BESS) is the only electrical energy storage system being used (as opposed to electrostatic supercapacitors, FESS, and HESS)

#### 1.1.4 [#8] Load Power Continuity
Uninterruptible Power Supplies, Emergency Generators, and Power Management Systems shall maintain the electrical power supplied to critical and essential loads during each defined loss-of-power condition.
Rationale: Loss of electrical power to loads can prevent the vessel from maintaining safety-critical and mission-critical functions.

#### 1.1.5 [#9] Electrical Power Quality
Local automatic voltage regulator, governor, converter, and harmonic filter devices shall be used in tandem with central power management and transformer systems to regulate voltage, frequency, and waveform in accordance with the defined parameters.
Rationale: Shipboard equipment requires electrical power within defined operating limits to function correctly and avoid damage or loss of performance.

### 1.2 [#10] Machinery Fluid Services
The vessel shall provide the fluids required to support the operation of installed machinery.
Rationale: Installed machinery requires cooling media, lubrication oil, fuel oil, compressed air, and hydraulic fluid to perform the allocated functions.

#### 1.2.1 [#11] Cooling Fluid Services
The cooling fluid service shall remove and transport thermal energy from installed machinery to maintain its required operating temperature limits.
Rationale: Installed machinery generates thermal energy during operation that must be transferred to an appropriate heat sink to maintain reliable operation and prevent thermal degradation.

##### 1.2.1.1 [#19] Freshwater Cooling
The freshwater cooling service shall circulate coolant through closed-loop circuits to absorb thermal energy from designated machinery.
Rationale: Closed-loop freshwater cooling removes thermal energy directly from machinery while minimizing corrosion, contamination, and fouling of internal cooling passages.

#### 1.2.2 [#12] Lubrication Services
The lubrication service shall establish and maintain the lubricating conditions required for the operation of installed machinery.
Rationale: Relative motion between contacting mechanical surfaces generates friction and wear that must be controlled to ensure reliable machinery operation and acceptable component life.

#### 1.2.3 [#13] Fuel Oil Services
The fuel oil service shall administer the chemical energy required for the operation of installed fuel-consuming machinery.
Rationale: Prime movers and auxiliary fuel-consuming systems rely on the combustion of fuel to convert chemical energy into the mechanical energy required for mechanical and electrical power generation.

##### 1.2.3.1 [#14] Propulsion Machinery Fuel Oil Supply
The propulsion fuel oil service shall administer fuel oil to propulsion machinery to support the generation of propulsive power for vessel mobility and maneuvering.
Rationale: Propulsion machinery converts the chemical energy stored in fuel into mechanical power to propel and maneuver the vessel throughout its operating envelope.

##### 1.2.3.2 [#15] Auxiliary Machinery Fuel Oil Supply
The auxiliary power fuel oil service shall administer fuel oil to auxiliary power generation systems to support power generation for auxiliary services.
Rationale: Auxiliary power generation converts the chemical energy stored in fuel into the power required to support auxiliary services.

#### 1.2.4 [#17] Compressed Air Supply
The compressed air service shall generate, store, regulate, and administer compressed air to supply the pneumatic power required for the operation of installed machinery.
Rationale: Compressed air stores potential energy that is converted to pneumatic power for designated shipboard functions requiring controlled fluid pressure.

#### 1.2.5 [#21] Hydraulic Fluid Services
The hydraulic fluid service shall pressurize and circulate hydraulic fluid to transmit power to installed hydraulically actuated machinery.
Rationale: Hydraulically actuated machinery requires pressurized fluid to transmit power and produce controlled mechanical motion or force.

### 1.3 [#25] Thermal Management
The thermal management service shall regulate, recover, and reject thermal energy to maintain the thermal conditions required by installed equipment and machinery spaces.
Rationale: Installed equipment and operating machinery generate thermal energy that must be managed to prevent overheating, preserve required equipment performance, and maintain acceptable machinery-space conditions; thermal energy is recovered and reused when economically feasible.

#### 1.3.1 [#26] Thermal Environment Control
The thermal-environment-control service shall regulate the thermal conditions required within designated vessel spaces.
Rationale: Equipment performance, machinery reliability, and material integrity depend upon maintaining environmental temperatures within their specified operating limits.

##### 1.3.1.1 [#27] Machinery-Space Thermal Control
The machinery-space thermal-control service shall regulate the thermal conditions required within designated machinery spaces.
Rationale: Heat released by installed machinery must be managed to maintain acceptable operating conditions within machinery spaces.

##### 1.3.1.2 [#28] Equipment-Space Thermal Control
The equipment-space thermal-control service shall regulate the thermal conditions required within designated equipment spaces.
Rationale: Temperature-sensitive electrical, electronic, command, surveillance, and mission equipment require controlled thermal environments to maintain their performance and reliability.

#### 1.3.2 [#29] Thermal Energy Recovery
The thermal-energy-recovery service shall recover usable thermal energy from designated vessel heat sources.
Rationale: Thermal energy generated during vessel operation may be recovered and redirected to shipboard uses, reducing the demand for additional energy sources.

##### 1.3.2.1 [#31] Recovered Thermal Energy Utilization
The recovered-thermal-energy-utilization service shall transfer recovered thermal energy to designated shipboard thermal loads.
Rationale: Recovered thermal energy can satisfy shipboard heating demands that would otherwise require additional fuel or electrical power.

#### 1.3.3 [#32] Environmental Heat Rejection
The environmental heat-rejection service shall discharge thermal energy that cannot be beneficially utilized to available external heat sinks.
Rationale: Thermal energy that cannot be recovered for useful purposes must ultimately be rejected to prevent heat accumulation and sustain continuous vessel operation.

##### 1.3.3.1 [#35] Seawater Heat Rejection
The seawater heat-rejection service shall transfer thermal energy from designated vessel cooling circuits to the surrounding seawater.
Rationale: The seawater surrounding the vessel provides a high-capacity external heat sink for the sustained rejection of thermal energy generated during vessel operation.

##### 1.3.3.2 [#36] Air Heat Rejection
The air heat-rejection service shall transfer thermal energy from designated vessel systems to the surrounding atmosphere where atmospheric heat rejection is required.
Rationale: Ambient air provides an external heat sink for systems designed to reject thermal energy directly to the atmosphere.

#### 1.3.4 [#38] Thermal Energy Transfer
The thermal-energy-transfer service shall transfer thermal energy between designated thermal systems while maintaining the required separation of working media.
Rationale: Thermal energy must frequently be transferred between independent thermal systems without mixing the associated working media in order to support cooling, heating, recovery, and rejection processes.

### 1.4 [#39] Shipboard Water Services
The shipboard water services shall process, store, and distribute different grades of water according to end use.
Rationale: Water aboard ship supports both machinery and personnel through multiple water qualities and distribution networks.

#### 1.4.1 [#48] Freshwater Production
Freshwater production shall treat seawater intake through reverse osmosis or distillation such that the end product is desalinated.
(Assumption: for simplification, freshwater services intakes seawater only)
Rationale: Freshwater production onboard reduces the vessel's dependence on shore-side and bunkering replenishment.

#### 1.4.2 [#51] Freshwater Storage
The freshwater storage service shall retain freshwater in designated tanks while preserving the volume and water quality required for subsequent shipboard use.
Rationale: Freshwater must be retained between production or replenishment and consumption so that shipboard demand can be met despite variations in production rate, replenishment availability, and usage.
(Assumption: freshwater is not distributed to consumption outlets immediately after production and moved to tanks first instead)

#### 1.4.3 [#52] Machinery Makeup Water
The machinery makeup water service shall replenish freshwater losses within closed-loop machinery circuits.
Rationale: Closed-loop machinery systems such as cooling circuits gradually lose water through maintenance, leakage, venting, or sampling.

#### 1.4.4 [#53] Freshwater Distribution
The freshwater distribution service shall use pumps and valves configured in designated paths to convey freshwater to and from storage tanks at flow rates and pressures in accordance with the defined parameters.
Rationale: Freshwater tanks and consumers require controlled conveyance for storage safety, point-of-use safety, and practical use.

#### 1.4.5 [#55] Potable Water Production
Potable water production shall treat freshwater intake through remineralization, pH adjustment, and disinfection such that the end product is potable.
(Assumption: for simplification, potable water services intakes freshwater only)
Rationale: Personnel require potable water for drinking, food preparation, and hygiene.

#### 1.4.6 [#56] Potable Water Storage
The potable storage service shall retain freshwater in designated tanks while preserving the volume and water quality required for subsequent shipboard use.
Rationale: Potable water must be retained between production or replenishment and consumption so that shipboard demand can be met despite variations in production rate, replenishment availability, and usage.
(Assumption: potable water is not distributed to consumption outlets immediately after production and moved to tanks first instead)

#### 1.4.7 [#57] Potable Water Distribution
The potable water distribution service shall use pumps and valves configured in designated paths to convey freshwater to and from storage tanks at flow rates and pressures in accordance with the defined parameters.
Rationale: Potable water tanks and consumers require controlled conveyance to ensure storage safety, point-of-use safety, and practical use.

### 1.5 [#61] Waste Management
The waste-management service shall control the collection, segregation, processing, retention, and disposition of waste streams generated during vessel operation.
Rationale: Vessel operation generates waste streams with differing physical and chemical properties, hazards, processing needs, and discharge restrictions that must be managed to protect personnel, equipment, the vessel, and the surrounding environment.

#### 1.5.1 [#72] Oily Waste Management
The oily-waste-management service shall collect, separate, monitor, retain, and dispose of oily mixtures and oil residues generated by machinery-space operations.
Rationale: Machinery operation generates oily bilge water and oil residues that require controlled handling to prevent marine pollution.
Basis: MARPOL Annex I (Prevention of Pollution by Oil)

#### 1.5.2 [#73] Sewage Management
The sewage-management service shall collect, treat, retain, and dispose of sewage generated aboard the vessel.
Rationale: Sewage requires controlled treatment and disposition to protect personnel health and the marine environment.
Basis: MARPOL Annex IV (Prevention of Pollution by Sewage from Ships)

#### 1.5.3 [#74] Garbage Management
The garbage-management service shall collect, segregate, process, retain, and dispose of ship-generated garbage according to its material category.
Rationale: Different garbage categories require different handling methods to support environmental compliance and efficient vessel operation.
Basis: MARPOL Annex V (Prevention of Pollution by Garbage from Ships)

### 1.6 [#75] Atmospheric Management
The atmospheric management service shall maintain the atmospheric conditions required to support personnel, installed equipment, and vessel operations.
Rationale: The vessel atmosphere must be continuously managed to maintain acceptable air quality, ventilation, contaminant control, and other atmospheric conditions necessary for safe, healthy, and reliable vessel operation.

#### 1.6.1 [#76] Ventilation
Ventilation shall circulate and exchange air within designated vessel spaces to maintain the defined air quality parameters for that space.
Rationale: Air circulation and ventilation distribute fresh air, remove contaminants, prevent stagnant air, and maintain acceptable atmospheric conditions throughout occupied and designated equipment spaces.

#### 1.6.2 [#77] Hazardous Gases Management
Hazardous gases management shall detect, isolate, and mitigate hazardous atmospheric conditions generated during vessel operation.
Rationale: Machinery operation, fuel handling, cargo operations, and onboard processes may generate hazardous atmospheres that require detection and mitigation to protect personnel, equipment, and the vessel.

#### 1.6.3 [#78] Emissions Management
Emissions Management shall control atmospheric emissions generated during vessel operation in accordance with applicable environmental regulations.
Rationale: Propulsion machinery, auxiliary machinery, incineration equipment, and other onboard processes generate atmospheric emissions that require control to reduce environmental impact and satisfy applicable emission regulations.
Basis: MARPOL Annex VI

### 1.7 [#79] Habitability

#### 1.7.1 [#80] Consumables Storage

#### 1.7.2 [#81] Domestic Water Use

## 2 [#86] Mission Systems Support
Mission systems support shall integrate and deploy the mission systems, payloads, and communications that comprise mission operations.
Rationale: Mission accomplishment depends upon the successful integration, operation, and coordination of mission systems and payloads.

### 2.1 [#87] Payload Intregration
Payload integration shall unite the payload with the platform through designated interfaces.
Rationale: The mission payload must be structurally constituted within the vessel, equipped with shipboard utilities and mission-specific auxiliary systems, and able to exchange information with centralized control systems and external sources to operate as an integrated vessel system.

#### 2.1.1 [#92] Structural Integration
Structural integration shall join the mission systems block and its payloads to the vessel platform through defined construction modes.
Rationale: Mission block modularity depends on the standardization of certain construction processes such that the configuration necessitated by the mission can be incorporated without incompatible structural, spatial, or access demands.
(rephrase for generality)

#### 2.1.2 [#93] Utility Integration
Utility integration shall connect the mission systems block to the platform services demanded by the payload.
Rationale: Mission payloads may demand electrical power, thermal management, fluid circulation, and ventilation that must be supplied through defined interfaces that are compatible with the hull architecture.

#### 2.1.3 [#94] Infotech Integration
Infotech integration shall install the data interfaces that support the control, monitoring, and communication capabilities demanded by the mission systems.
Rationale: Mission systems must exchange commands, status, sensor products, and other information with platform and external systems through compatible and secure interfaces.

### 2.2 [#88] Mission System Operation
Mission system operation shall provide the control and monitoring functions that operate the mission system equipment.
Rationale: For the equipment associated with the mission system to serve its intended purposes, operators of the equipment must be able to command, monitor, coordinate, and assess the equipment status.

### 2.3 [#89] Mission Data Management
Mission data management shall receive, collate, distribute, and store the mission data needed to inform mission-system operation and mission execution.
Rationale: Mission systems generate and consume information that must be managed throughout its operational lifecycle to support decision-making, coordination, and mission accomplishment.

### 2.4 [#90] Mission Communications
Mission communications shall exchange mission-related information with external entities to coordinate mission execution.
(Assumption: Internal communications are owned by Mission System Operation requirement)
Rationale: Mission accomplishment often depends upon the timely exchange of mission information, tasking, status, and payload products between the vessel and external organizations or systems.

### 2.5 [#91] Payload Maintenance
Payload maintenance shall protect installed mission systems and payloads from environmental and operational conditions that could degrade mission performance or damage mission equipment.